# Grasshopper definition SEC_[example]_LayoutMatrixApt.gh (Grasshopper 1.0.7)
# Copyright: prslvtsv
# plug-ins: Telepathy, Owl.GH

pdecon = Deconstruct()  # -> XComponent, YComponent, ZComponent; disabled
featurets = FeatureTensorSet(Feature0=pdecon.XComponent, Feature1=pdecon.YComponent, Feature2=pdecon.ZComponent)  # disabled
number_slider = Slider(4, range=0..10)  # disabled
number_slider_2 = Slider(10, range=0..10)  # disabled
kmeans = KMeansClustering(Data=featurets, Clusters=number_slider, Iterations=number_slider_2, Seed=123)  # -> Clusters, Indices; disabled
detset = DeconstructTensorSet(TensorSet=kmeans.Clusters)  # disabled
detensor = DeconstructTensor(Tensor=detset)  # disabled
num2pt = NumbersToPoints(Numbers=detensor, Mask=4)  # -> simplify(Points); disabled
trim = TrimTree(Tree=num2pt, Depth=1)  # disabled
tstat = TreeStatistics(Tree=trim)  # -> Paths, Length, Count; disabled
txt = Text(tstat.Length)  # disabled
txt_2 = Text(tstat.Paths)  # disabled
concat = Concatenate(FragmentA=txt_2, FragmentB=txt)  # disabled
cpreview = PreviewClasses(Geometry=trim, Name=concat, Position=Point(0.1, 0.1, 0.1), Size=12, Seed=txt)  # disabled

pipeline = GeometryPipeline(
    GroupByLayer=False,
    GroupByType=False,
    IncludeHidden=False,
    IncludeLocked=False,
    LayerFilter="polyominos::pts",
    NameFilter="*",
    SublayerFiltering=True,
    TypeFilter=1)
pgroups = PointGroups(Points=pipeline, Distance=Slider(2.5, range=0..10))  # -> Groups, Indices

# ---- group: floor_matrix
size_in_y_dir = Slider(11, range=0..20)
pt = Point([Point(5.07795973, 10.93092413, 0), Point(4.07795973, 8.930924128, 0), Point(4.07795973, 9.930924128, 0), Point(4.07795973, 10.93092413, 0), Point(4.07795973, 11.93092413, 0), Point(4.07795973, 12.93092413, 0)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])  # disabled
crv = Curve([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])  # disabled
to_polyominos = ToPolyominos(pt_existing=pt, size_in_y_dir=size_in_y_dir, grid_cells=crv)  # -> ij_existing, cells_to_remove, size_xy
board_remove_cells = RemoteSender(to_polyominos.cells_to_remove)
board_size = RemoteSender(to_polyominos.size_xy)

# ---- group: from guids
pipeline_2 = GeometryPipeline(
    GroupByLayer=False,
    GroupByType=False,
    IncludeHidden=False,
    IncludeLocked=False,
    LayerFilter="polyominos::crv",
    NameFilter="*",
    SublayerFiltering=True,
    TypeFilter=4)
id = Guid(pipeline_2)

# ----
crv_2 = Curve([<curve referenced from the Rhino model> x37])

# ---- group: from actual geometry
crv_3 = Curve([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])  # disabled
cp = ControlPoints(Curve=crv_3)  # -> Points, Weights, Knots; disabled
pline = PolyLine(Vertices=cp.Points, Closed=True)  # -> flatten(Polyline); disabled
group = Group(Objects=pline)  # disabled
dup = DuplicateData(Data=group, Number=10, Order=True)  # -> graft(Data); disabled
ungroup = Ungroup(Group=dup)  # disabled

# ---- group: from guids / index from neigbour curves
python = GhPythonScript(crv=id)  # -> indexes, curves; inputs crv: list
# ---------- python: Python ----------
## -*- coding: utf-8 -*-
#"""
#@author: prslvtsv
#"""
###############################################################
#import ghdev.devcon as dev
#reload(dev)
#
#dev.init_dev_tools(locals(),  config=dev_options, verbose=True)
###############################################################

import ghpythonlib.treehelpers as th
from  Rhino.Geometry import Point3d
from collections import OrderedDict as oddict
import gblock.ghhelp as ghh
import gh_components_script.gh_points2matrix as p2m
reload(p2m)
reload(ghh)

def crv2points(crv):
    poly = [ghh.Helper.get_by_id_geo(c).ToPolyline().ToArray() for c in crv]
    # remove 5th point 
    pt = [[p for p in pl][:-1] for pl in poly]
    return pt

def orient_poly_points(pt):
    pl_pts = []
    for pt in pt:
        pl_pts.append( [Point3d(x, y, 0) for (x, y) in p2m.sort_pt_xy(pt)])
    return pl_pts  
    
#def mapRange(value, leftMin, leftMax, rightMin, rightMax):
#    leftSpan = leftMax - leftMin
#    rightSpan = rightMax - rightMin
#    valueScaled = float(value - leftMin) / float(leftSpan)
#    return rightMin + (valueScaled * rightSpan)

def corners2index(corners):
    leftLow = [a[0] for a in corners]
    xll = [p.X for p in leftLow]
    unique_x= sorted(list(set([round(x) for x in xll])))
    ix = [unique_x.index(round(xp)) for xp in xll]
    
    rightTop = [a[2] for a in corners]
    yrt = [p.Y for p in rightTop]
    unique_y = sorted(list(set([round(y) for y in yrt])))
    jy = [unique_y.index(round(yp)) for yp in yrt]

#    indx_i = [int(mapRange(a, min(xll), max(xll), 0, len(unique_x)-1)) for a in xll]
#    indx_j = [int(mapRange(a, min(yrt), max(yrt), 0, len(unique_y)-1)) for a in yrt]
    print list(zip(ix, jy))
    return list(zip(ix, jy))

pts = crv2points(crv)
sorted_corners = orient_poly_points(pts)
indx = corners2index(sorted_corners)

#print sorted_corners
indexes = indx
curves = [ghh.Helper.get_by_id_geo(c) for c in crv]
# ---------- end python ----------

# ---- group: points to indexes
indx = GhPythonScript(points=pgroups.Groups)  # -> out, indexes, pt; inputs points: list of Point3d
# ---------- indx: Python ----------
import gblock.ghhelp as ghh
#reload(ghh)


indexes = ghh.xy2ij(points)
pt = points
# ---------- end indx ----------

# ----
pcen = PolygonCenter(Polyline=python.curves)  # -> CenterV, CenterE, CenterA
tag = TextTag(Location=pcen.CenterV, Text=python.indexes)

# ---- group: from actual geometry / index from neigbour curves (trees)
python_2 = GhPythonScript(crv=ungroup)  # -> indexes, curves; inputs crv: list of Polyline; disabled
# ---------- python_2: Python ----------
## -*- coding: utf-8 -*-
#"""
#@author: prslvtsv
#"""
###############################################################
#import ghdev.devcon as dev
#reload(dev)
#
#dev.init_dev_tools(locals(),  config=dev_options, verbose=True)
###############################################################

import ghpythonlib.treehelpers as th
from  Rhino.Geometry import Point3d
from collections import OrderedDict as oddict
import gblock.ghhelp as ghh
import gh_components_script.gh_points2matrix as p2m
reload(p2m)
reload(ghh)

def crv2points(crv):
    poly = [c.ToArray() for c in crv]
    # remove 5th point 
    pt = [[p for p in pl][:-1] for pl in poly]
    return pt

def orient_poly_points(pt):
    pl_pts = []
    for pt in pt:
        pl_pts.append( [Point3d(x, y, 0) for (x, y) in p2m.sort_pt_xy(pt)])
    return pl_pts  

def xy2ij(points):
    xx, yy = [p.X for p in points], [p.Y for p in points]
    unique_x= sorted(list(set([round(x) for x in xx])))
    unique_y = sorted(list(set([round(y) for y in yy])))
    i = [unique_x.index(round(xp)) for xp in xx]
    j = [unique_y.index(round(yp)) for yp in yy]
    print list(zip(ix, jy))
    return list(zip(ix, jy))
    
def corners2index(corners):
    leftLow = [a[0] for a in corners]
    xll = [p.X for p in leftLow]
    unique_x= sorted(list(set([round(x) for x in xll])))
    ix = [unique_x.index(round(xp)) for xp in xll]
    
    rightTop = [a[2] for a in corners]
    yrt = [p.Y for p in rightTop]
    unique_y = sorted(list(set([round(y) for y in yrt])))
    jy = [unique_y.index(round(yp)) for yp in yrt]


    print list(zip(ix, jy))
    return list(zip(ix, jy))

pts = crv2points(crv)
sorted_corners = orient_poly_points(pts)
indx = corners2index(sorted_corners)

#print sorted_corners
indexes = indx
curves = [c for c in crv]
# ---------- end python_2 ----------

# ---- group: display point groups
data = Data(indx.pt)
tstat_2 = TreeStatistics(Tree=data)  # -> Paths, Length, Count
txt_3 = Text(tstat_2.Length)
txt_4 = Text(tstat_2.Paths)
pt_2 = ConstructPoint(XCoordinate="0.2", YCoordinate="0.1", ZCoordinate="0.2")
concat_2 = Concatenate(FragmentA=txt_4, FragmentB=txt_3)
cpreview_2 = PreviewClasses(Geometry=data, Name=concat_2, Position=pt_2, Size=12, Seed=123)

# ---- group: display
vec = VectorXYZ(XComponent=0, YComponent="0.2", ZComponent=0)  # -> Vector, Length
move = Move(Geometry=indx.pt, Motion=vec.Vector)  # -> Geometry, Transform
cluster = Cluster(p=indx.pt)

# ---- group: create from indexes
python_3 = GhPythonScript(indexes=indx.indexes)  # -> out, matrix, cells; inputs indexes: list
# ---------- python_3: Python ----------
# -*- coding: utf-8 -*-
"""
@author: prslvtsv
"""
###############################################################
#import ghdev.devcon as dev
#reload(dev)
#
#dev.init_dev_tools(locals(),  config=dev_options, verbose=True)
###############################################################
import gblock.elements.matrix as mtx
reload(mtx)


matrix = mtx.SpacialMatrix().from_indexes(indexes, data="cell")
cells = matrix.active_indexes()
# ---------- end python_3 ----------

# ----
pcen_2 = PolygonCenter(Polyline=python_2.curves)  # -> CenterV, CenterE, CenterA; disabled

# ---- group: display / display cells tiles
display = Display(geo_to_viz=cluster)

# ---- group: display / display indexing
tag_2 = TextTag(Location=move.Geometry, Text=indx.indexes, Colour=ColourSwatch(SwatchColor=RGB(255, 255, 255)))

# ----
tag_3 = TextTag(Location=pcen_2.CenterV, Text=python_2.indexes)  # disabled

# ---- group: creating filing matrix
python_4 = GhPythonScript(size_i=Slider(3, range=0..10), size_j=Slider(5, range=0..10))  # -> out, a; inputs size_i: Int32, size_j: Int32
# ---------- python_4: Python ----------
# -*- coding: utf-8 -*-
"""
@author: prslvtsv
"""
###############################################################
#import ghdev.devcon as dev
#reload(dev)
#
#dev.init_dev_tools(locals(),  config=dev_options, verbose=True)
###############################################################
import gblock.elements.matrix as mtx
reload(mtx)


matrix = mtx.SpacialMatrix().empty((size_i, size_j))
print matrix.raw()

all_indexes = [(i, j) for j in range(size_j) for i in range(size_i)]
#matrix.fill_by_indexes(tuple(zip(tuple(range(3)), tuple(range(3)))), "obj")
print all_indexes
matrix.fill_by_indexes(all_indexes, "obj")
print matrix.raw()
# ---------- end python_4 ----------

# ----
panel = Panel(python_4.out)

active = Panel(to_polyominos.ij_existing)
to_remove = Panel(to_polyominos.cells_to_remove)
to_remove_2 = Panel(to_polyominos.size_xy)

# ---- group: create from indexes
python_5 = GhPythonScript(indexes_str=active)  # -> out, a
# ---------- python_5: Python ----------
# -*- coding: utf-8 -*-
"""
@author: prslvtsv
"""
###############################################################
#import ghdev.devcon as dev
#reload(dev)
#
#dev.init_dev_tools(locals(),  config=dev_options, verbose=True)
###############################################################
import gblock.elements.matrix as mtx
reload(mtx)

indx = mtx.SpacialMatrix.parse_indexes(indexes_str)
print indx
print ()
matrix = mtx.SpacialMatrix().from_indexes(indx, data="cell")
print matrix.raw()
print()
print matrix.active_indexes()
print()

corresponding_data = [ "C::{}:{}".format(ix[0], ix[1]) for ix in indx]
matrix_ix = mtx.SpacialMatrix.create_from_indexes(indx, data=corresponding_data)
def gp(a):
    print a
    
[gp(line) for line in  matrix_ix.raw()]
# ---------- end python_5 ----------

# ----
active_2 = Panel(python_5.out)

# ==== cluster ToPolyominos
grid_cells = ClusterInput()  # grid_cells
size_in_y_dir = ClusterInput()  # size in Y dir
pt_existing = ClusterInput()  # pt_existing
data = Data(grid_cells)
pcen = PolygonCenter(Polyline=data)  # -> CenterV, CenterE, CenterA
sort_pt = SortPoints(Points=pcen.CenterV)  # -> Points, Indices
data_2 = Data(size_in_y_dir)
data_3 = Data(pt_existing)
partition = PartitionList(List=sort_pt.Points, Size=data_2)
cir = Circle(Plane=data_3, Radius=0.3)
sort_pt_2 = SortPoints(Points=partition)  # -> Points, Indices
pdecon = Deconstruct(Point=sort_pt_2.Points)  # -> XComponent, YComponent, ZComponent
panel = Panel(sort_pt_2.Points)
sort = SortList(Keys=pdecon.YComponent, ValuesA=sort_pt_2.Points)  # -> Keys, ValuesA
flip = FlipMatrix(Data=sort.ValuesA)
ptcomposenum = ComposeGridNumber(Points=flatten(flip), RowNum=data_2)
incurve = PointInCurve(Point=graft(ptcomposenum), Curve=cir)  # -> Relationship, Point
ma = MassAddition(Input=incurve.Relationship)  # -> Result, PartialResults
viewer = ParamViewer(ptcomposenum)
trim = TrimTree(Tree=ma.Result, Depth=1)
bool = Boolean(ma.Result)
bool_2 = Boolean(trim)
not = GateNot(A=bool_2)
ptindices = ExtractGridIndices(Grid=ptcomposenum)  # -> I_Indices, J_Indices
branch = TreeBranch(Tree=ptcomposenum, Path=Slider(0, range=0..10), MaintainPaths=True)
cull = CullPattern(List=ptindices.I_Indices, CullPattern=bool_2)
cull_2 = CullPattern(List=ptindices.J_Indices, CullPattern=bool_2)
cull_3 = CullPattern(List=ptindices.J_Indices, CullPattern=not)
cull_4 = CullPattern(List=ptindices.I_Indices, CullPattern=not)
lng = ListLength(List=ptcomposenum)  # -> flatten(Length)
clean = CleanTree(RemoveNulls=True, RemoveInvalid=True, RemoveEmpty=True, Tree=cull_4)
clean_2 = CleanTree(RemoveNulls=True, RemoveInvalid=True, RemoveEmpty=True, Tree=cull_3)
python = GhPythonScript(x=cull_2, y=cull)  # -> out, a
# ---------- python: Python ----------
# -*- coding: utf-8 -*-
"""
@author: prslvtsv
"""
a = "{},{}".format(x, y)
# ---------- end python ----------
item = ListItem(List=lng, Index=0, Wrap=True)
lng_2 = ListLength(List=lng)
python_2 = GhPythonScript(x=clean_2, y=clean)  # -> out, flatten(a); same code as python
python_3 = GhPythonScript(x=flatten(python_2.a))  # -> out, a; inputs x: list
# ---------- python_3: Python ----------
# -*- coding: utf-8 -*-
"""
@author: prslvtsv
"""
b = ", ".join(x)
a = "[" + b + "]"
# ---------- end python_3 ----------
python_4 = GhPythonScript(x=flatten(python.a))  # -> out, a; inputs x: list
# ---------- python_4: Python ----------
# -*- coding: utf-8 -*-
"""
@author: prslvtsv
"""
b = ":".join(x)
a = b
# ---------- end python_4 ----------
merge = Merge(Data1=item, Data2=lng_2)
python_5 = GhPythonScript(x=flatten(python_2.a))  # -> out, a; inputs x: list
# ---------- python_5: Python ----------
# -*- coding: utf-8 -*-
"""
@author: prslvtsv
"""
j = ":".join(x)
a = j
# ---------- end python_5 ----------
join = TextJoin(Text=merge, Join=",")
ij_existing = ClusterOutput(python_4.a)  # ij_existing
cells_to_remove = ClusterOutput(python_5.a)  # ij_remove
panel_2 = Panel(python_5.a)
size_xy = ClusterOutput(join)  # size_XY

# ==== cluster Display
geo_to_viz = ClusterInput()
data = Data(geo_to_viz)
color = Color(data_in=data)
runion = RegionUnion(Curves=data)
boundary = BoundarySurfaces(Edges=runion)
addition = Addition(A=color, B=ColourSwatch(SwatchColor=RGB(150, 150, 150)))
preview = CustomPreview(Geometry=simplify(boundary), Material=simplify(color))
previewlw = CustomPreviewLineweights(
    Geometry=simplify(runion),
    Shader=simplify(ColourSwatch(SwatchColor=RGBA(0, 0, 0, 212))),
    Thickness=Slider(2, range=0..10),
    Absolute=False)
previewlw_2 = CustomPreviewLineweights(Geometry=simplify(data), Shader=simplify(addition), Thickness=Slider(0, range=0..10), Absolute=False)
previewmat = CustomPreviewMaterials(Geometry=boundary, DiffuseColor=color, Transparency=Slider(0.197, range=0..1))
createhatch = CreateHatch(Bake=False, Curves=runion, HatchPatternName="Hatch1", HatchScale=0.8, HatchRotation=45)  # -> HatchGeometry, HatchObjects
number_slider = Slider(0.625, range=0..1)
preview_2 = CustomPreview(Geometry=simplify(createhatch.HatchGeometry), Material=simplify(color))

# ==== cluster Cluster
p = ClusterInput()  # p
pdecon = Deconstruct(Point=p)  # -> XComponent, YComponent, ZComponent
data = Data(Slider(1, range=0..1))
number_slider = Slider(2, range=0..10)
ghpython_script = GhPythonScript(x=pdecon.XComponent, c=data)  # -> a
# ---------- ghpython_script: Python ----------
# -*- coding: utf-8 -*-
"""
@author: prslvtsv
"""
###############################################################
#import ghdev.devcon as dev
#reload(dev)
#
#dev.init_dev_tools(locals(),  config=dev_options, verbose=True)
###############################################################


a = x*c + c
# ---------- end ghpython_script ----------
ghpython_script_2 = GhPythonScript(x=pdecon.YComponent, c=data)  # -> a
# ---------- ghpython_script_2: Python ----------
# -*- coding: utf-8 -*-
"""
@author: prslvtsv
"""
###############################################################
#import ghdev.devcon as dev
#reload(dev)
#
#dev.init_dev_tools(locals(),  config=dev_options, verbose=True)
###############################################################


a = x*c
# ---------- end ghpython_script_2 ----------
ghpython_script_3 = GhPythonScript(x=pdecon.XComponent, c=data)  # -> a; same code as ghpython_script_2
addition = Addition(A=ghpython_script_3, B=ghpython_script)
ghpython_script_4 = GhPythonScript(x=pdecon.YComponent, c=data)  # -> a; same code as ghpython_script
addition_2 = Addition(A=ghpython_script_2, B=ghpython_script_4)
subtraction = Subtraction(A=ghpython_script_2, B=ghpython_script_4)
subtraction_2 = Subtraction(A=ghpython_script_3, B=ghpython_script)
pt = ConstructPoint(XCoordinate=ghpython_script_3, YCoordinate=ghpython_script_2, ZCoordinate=0)
pt_2 = ConstructPoint(XCoordinate=ghpython_script, YCoordinate=ghpython_script_4, ZCoordinate=0)
division = Division(A=subtraction_2, B=number_slider)
division_2 = Division(A=subtraction, B=number_slider)
rec_2pt = Rectangle2Pt(Plane=PlaneXY(0, 0, 0), PointA=pt, PointB=pt_2, Radius=0)  # -> Rectangle, Length
vec = VectorXYZ(XComponent=division, YComponent=division_2, ZComponent=0)  # -> Vector, Length
move = Move(Geometry=rec_2pt.Rectangle, Motion=vec.Vector)  # -> Geometry, Transform
pcen = PolygonCenter(Polyline=move.Geometry)  # -> CenterV, CenterE, CenterA
boundary = BoundarySurfaces(Edges=move.Geometry)
G = ClusterOutput(move.Geometry)

# ==== cluster Color
data_in = ClusterInput()  # data_in
dom = ConstructDomain(DomainStart=Slider(0.168, range=0..1), DomainEnd=Slider(0.922, range=0..1))
tstat = TreeStatistics(Tree=data_in)  # -> Paths, Length, Count
bbox = BoundingBox(Content=data_in, Plane=PlaneXY(0, 0, 0), UnionBox=True)  # -> Box, Box_2
extremums = MinMax(Number=tstat.Length)  # -> Minimum, Maximum
range = Range(Domain=dom, Steps=expr("x-1", tstat.Length))
dim = Dimensions(Surface=bbox.Box)  # -> UDimension, VDimension
area = Area(Geometry=bbox.Box)  # -> Area, Centroid
pcshuffle = Shuffle(List=range, Seed=Slider(1, range=0..1), LastSaveLocalization="neutral,N")
extremums_2 = MinMax(Number=flatten(dim.UDimension))  # -> Minimum, Maximum
wheel = ColourWheel(
    extremums_2.Maximum,
    ColourGrips_Style=10,
    ColourGrips_Grip=[5.115610268, 3.821325235, 1.989214472, 5.130807126],
    ColourGrips_Lum=[0.1, 1],
    ColourGrips_Range=[0.5123760279, 0.5123760279, 0.5123760279, 0.5123760279],
    ColourGrips_Sat=[0.2, 1])
addition = Addition(A=dim.UDimension, B=area.Area)
hsv = ColourHSV(Alpha=1, Hue=pcshuffle, Saturation=1, Value=1)
subtraction = Subtraction(A=dim.UDimension, B=extremums_2.Minimum)
hsl = ColourHSL(Alpha=0.7, Hue=pcshuffle, Saturation=1, Luminance=Slider(0.247, range=0..1))
data = Data(graft(wheel))
data_2 = Data(simplify(graft(hsv)))
item = ListItem(List=hsv, Index=subtraction, Wrap=True)  # -> simplify(Item)
panel = Panel(dim.UDimension)
addition_2 = Addition(A=data_2, B=item)
division = Division(A=addition_2, B=2)
panel_2 = Panel(division)
color_out = ClusterOutput(item)  # color_out
